# Grasshopper definition TECHNO PARK UPR 2023 GH DEFINITION.gh (Grasshopper 1.0.7)
# plug-ins: Parakeet, LunchBox, Pufferfish

range = Range(Domain=Slider(1, range=0..1), Steps=Slider(20, range=0..50))
curve = Curve(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)
curve_2 = Curve(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)
curve_3 = Curve(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)
curve_4 = Curve(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)
curve_5 = Curve(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)
curve_6 = Curve(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)
curve_7 = Curve(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)
curve_8 = Curve(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)
curve_9 = Curve(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)
curve_10 = Curve(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)
curve_11 = Curve(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)
curve_12 = Curve(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)
curve_13 = Curve(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)
join_curves = JoinCurves(Curves=[curve_7, curve_8, curve_9], Preserve=False)
join_curves_2 = JoinCurves(Curves=[curve_10, curve_11, curve_12], Preserve=False)
curve_14 = Curve([curve, curve_6, curve_7, curve_8, curve_9, curve_10, curve_11, curve_12, curve_13, curve_2, curve_3, curve_4, curve_5])

curve_15 = Curve(curve_7)
curve_16 = Curve(curve_10)
curve_17 = Curve(curve_8)
curve_18 = Curve(curve_11)
curve_19 = Curve(curve_12)
curve_20 = Curve(curve_9)

tween_curve = TweenCurve(CurveA=curve_2, CurveB=curve_3, Factor=range, BlendType=0)
tween_curve_2 = TweenCurve(CurveA=curve_3, CurveB=curve_4, Factor=range, BlendType=0)
tween_curve_3 = TweenCurve(CurveA=curve, CurveB=curve_6, Factor=range, BlendType=0)
tween_curve_4 = TweenCurve(CurveA=curve_6, CurveB=join_curves, Factor=range, BlendType=0)

tween_curve_5 = TweenCurve(CurveA=curve_15, CurveB=curve_16, Factor=range, BlendType=0)
tween_curve_6 = TweenCurve(CurveA=curve_17, CurveB=curve_18, Factor=range, BlendType=0)
tween_curve_7 = TweenCurve(CurveA=curve_20, CurveB=curve_19, Factor=range, BlendType=0)

tween_curve_8 = TweenCurve(CurveA=join_curves_2, CurveB=curve_13, Factor=range, BlendType=0)
tween_curve_9 = TweenCurve(CurveA=curve_13, CurveB=curve_2, Factor=range, BlendType=0)
tween_curve_10 = TweenCurve(CurveA=curve_4, CurveB=curve_5, Factor=range, BlendType=0)
loft = Loft(Curves=tween_curve_3, Options={Adjust=False, Closed=False, LoftEnds=0, LoftSimp=0, LoftType=0, Rebuild=10, Refit=0.01})
loft_2 = Loft(Curves=tween_curve_4, Options={Adjust=False, Closed=False, LoftEnds=0, LoftSimp=0, LoftType=0, Rebuild=10, Refit=0.01})

loft_3 = Loft(Curves=tween_curve_5, Options={Adjust=False, Closed=False, LoftEnds=0, LoftSimp=0, LoftType=0, Rebuild=10, Refit=0.01})
loft_4 = Loft(Curves=tween_curve_6, Options={Adjust=False, Closed=False, LoftEnds=0, LoftSimp=0, LoftType=0, Rebuild=10, Refit=0.01})
loft_5 = Loft(Curves=tween_curve_7, Options={Adjust=False, Closed=False, LoftEnds=0, LoftSimp=0, LoftType=0, Rebuild=10, Refit=0.01})

loft_6 = Loft(Curves=tween_curve_8, Options={Adjust=False, Closed=False, LoftEnds=0, LoftSimp=0, LoftType=0, Rebuild=10, Refit=0.01})
loft_7 = Loft(Curves=tween_curve_9, Options={Adjust=False, Closed=False, LoftEnds=0, LoftSimp=0, LoftType=0, Rebuild=10, Refit=0.01})
loft_8 = Loft(Curves=tween_curve, Options={Adjust=False, Closed=False, LoftEnds=0, LoftSimp=0, LoftType=0, Rebuild=10, Refit=0.01})
loft_9 = Loft(Curves=tween_curve_2, Options={Adjust=False, Closed=False, LoftEnds=0, LoftSimp=0, LoftType=0, Rebuild=10, Refit=0.01})
loft_10 = Loft(Curves=tween_curve_10, Options={Adjust=False, Closed=False, LoftEnds=0, LoftSimp=0, LoftType=0, Rebuild=10, Refit=0.01})
head_breps = Surface(flatten([loft, loft_2]))
brep_join = BrepJoin(Breps=head_breps)  # -> Breps, Closed
brep = Brep([loft_6, loft_8, loft_10])

# ---- group: Brep Offset Function
offset_brep = OffsetBrep(
    Brep=brep_join.Breps,
    Distance=expr("-x", Slider(0.2, range=0..1)),
    Solid=Toggle(False),
    BothSides=Toggle(False),
    RoundCorners=Toggle(True),
    MergeFaces=Toggle(True))
deconstruct_brep = DeconstructBrep(Brep=offset_brep)  # -> Faces, Edges, Vertices

offset_brep_2 = OffsetBrep(
    Brep=brep,
    Distance=expr("-x", Slider(0.4, range=0..1)),
    Solid=Toggle(False),
    BothSides=Toggle(False),
    RoundCorners=Toggle(True),
    MergeFaces=Toggle(True))
deconstruct_brep_2 = DeconstructBrep(Brep=offset_brep_2)  # -> flatten(Faces), Edges, Vertices

# ----
list_item = ListItem(List=deconstruct_brep.Faces, Index="4", Wrap=True)
list_item_2 = ListItem(List=deconstruct_brep.Faces, Index="5", Wrap=True)
list_item_3 = ListItem(List=deconstruct_brep_2.Faces, Index="0", Wrap=False)
list_item_4 = ListItem(List=deconstruct_brep_2.Faces, Index="1", Wrap=True)
list_item_5 = ListItem(List=deconstruct_brep_2.Faces, Index="2", Wrap=True)

# ---- group: Fixing Brep Offset
domain = Slider(1, range=0..1)
curve_count = Slider(100, range=0..100)
range_2 = Range(Domain=domain, Steps=curve_count)
construct_point = ConstructPoint(XCoordinate=0, YCoordinate=range_2, ZCoordinate=0)
domain_2 = Slider(1, range=0..1)
curve_count_2 = Slider(100, range=0..100)
iso_curve = IsoCurve(Surface=reparameterize(list_item), UVPoint=construct_point)  # -> UIsocurve, VIsocurve
range_3 = Range(Domain=domain_2, Steps=curve_count_2)
curve_21 = Curve(flatten(iso_curve.UIsocurve))
loft_11 = Loft(Curves=curve_21, Options={Adjust=False, Closed=False, LoftEnds=0, LoftSimp=0, LoftType=0, Rebuild=10, Refit=0.01})
construct_point_2 = ConstructPoint(XCoordinate=0, YCoordinate=range_3, ZCoordinate=0)
iso_curve_2 = IsoCurve(Surface=reparameterize(loft_11), UVPoint=construct_point_2)  # -> flatten(UIsocurve), VIsocurve
loft_12 = Loft(
    Curves=iso_curve_2.UIsocurve,
    Options={Adjust=False, Closed=False, LoftEnds=0, LoftSimp=0, LoftType=0, Rebuild=10, Refit=0.01})

domain_3 = Slider(1, range=0..1)
curve_count_3 = Slider(100, range=0..100)
range_4 = Range(Domain=domain_3, Steps=curve_count_3)
construct_point_3 = ConstructPoint(XCoordinate=0, YCoordinate=range_4, ZCoordinate=0)
domain_4 = Slider(1, range=0..1)
curve_count_4 = Slider(100, range=0..100)
iso_curve_3 = IsoCurve(Surface=reparameterize(list_item_2), UVPoint=construct_point_3)  # -> UIsocurve, VIsocurve
range_5 = Range(Domain=domain_4, Steps=curve_count_4)
curve_22 = Curve(flatten(iso_curve_3.UIsocurve))
loft_13 = Loft(Curves=curve_22, Options={Adjust=False, Closed=False, LoftEnds=0, LoftSimp=0, LoftType=0, Rebuild=10, Refit=0.01})
construct_point_4 = ConstructPoint(XCoordinate=0, YCoordinate=range_5, ZCoordinate=0)
iso_curve_4 = IsoCurve(Surface=reparameterize(loft_13), UVPoint=construct_point_4)  # -> flatten(UIsocurve), VIsocurve
loft_14 = Loft(
    Curves=iso_curve_4.UIsocurve,
    Options={Adjust=False, Closed=False, LoftEnds=0, LoftSimp=0, LoftType=0, Rebuild=10, Refit=0.01})

domain_5 = Slider(1, range=0..1)
curve_count_5 = Slider(100, range=0..100)
range_6 = Range(Domain=domain_5, Steps=curve_count_5)
construct_point_5 = ConstructPoint(XCoordinate=0, YCoordinate=range_6, ZCoordinate=0)
curve_count_6 = Slider(100, range=0..100)
domain_6 = Slider(1, range=0..1)
iso_curve_5 = IsoCurve(Surface=reparameterize(list_item_3), UVPoint=construct_point_5)  # -> UIsocurve, VIsocurve
range_7 = Range(Domain=domain_6, Steps=curve_count_6)
curve_23 = Curve(flatten(iso_curve_5.UIsocurve))
loft_15 = Loft(Curves=curve_23, Options={Adjust=False, Closed=False, LoftEnds=0, LoftSimp=0, LoftType=0, Rebuild=10, Refit=0.01})
construct_point_6 = ConstructPoint(XCoordinate=0, YCoordinate=range_7, ZCoordinate=0)
iso_curve_6 = IsoCurve(Surface=reparameterize(loft_15), UVPoint=construct_point_6)  # -> flatten(UIsocurve), VIsocurve
loft_16 = Loft(
    Curves=iso_curve_6.UIsocurve,
    Options={Adjust=False, Closed=False, LoftEnds=0, LoftSimp=0, LoftType=0, Rebuild=10, Refit=0.01})

domain_7 = Slider(1, range=0..1)
curve_count_7 = Slider(100, range=0..100)
range_8 = Range(Domain=domain_7, Steps=curve_count_7)
construct_point_7 = ConstructPoint(XCoordinate=0, YCoordinate=range_8, ZCoordinate=0)
domain_8 = Slider(1, range=0..1)
curve_count_8 = Slider(100, range=0..100)
iso_curve_7 = IsoCurve(Surface=reparameterize(list_item_4), UVPoint=construct_point_7)  # -> UIsocurve, VIsocurve
range_9 = Range(Domain=domain_8, Steps=curve_count_8)
curve_24 = Curve(flatten(iso_curve_7.UIsocurve))
loft_17 = Loft(Curves=curve_24, Options={Adjust=False, Closed=False, LoftEnds=0, LoftSimp=0, LoftType=0, Rebuild=10, Refit=0.01})
construct_point_8 = ConstructPoint(XCoordinate=0, YCoordinate=range_9, ZCoordinate=0)
iso_curve_8 = IsoCurve(Surface=reparameterize(loft_17), UVPoint=construct_point_8)  # -> flatten(UIsocurve), VIsocurve
loft_18 = Loft(
    Curves=iso_curve_8.UIsocurve,
    Options={Adjust=False, Closed=False, LoftEnds=0, LoftSimp=0, LoftType=0, Rebuild=10, Refit=0.01})

domain_9 = Slider(1, range=0..1)
curve_count_9 = Slider(100, range=0..100)
range_10 = Range(Domain=domain_9, Steps=curve_count_9)
construct_point_9 = ConstructPoint(XCoordinate=0, YCoordinate=range_10, ZCoordinate=0)
domain_10 = Slider(1, range=0..1)
curve_count_10 = Slider(100, range=0..100)
iso_curve_9 = IsoCurve(Surface=reparameterize(list_item_5), UVPoint=construct_point_9)  # -> UIsocurve, VIsocurve
range_11 = Range(Domain=domain_10, Steps=curve_count_10)
curve_25 = Curve(flatten(iso_curve_9.UIsocurve))
loft_19 = Loft(Curves=curve_25, Options={Adjust=False, Closed=False, LoftEnds=0, LoftSimp=0, LoftType=0, Rebuild=10, Refit=0.01})
construct_point_10 = ConstructPoint(XCoordinate=0, YCoordinate=range_11, ZCoordinate=0)
iso_curve_10 = IsoCurve(Surface=reparameterize(loft_19), UVPoint=construct_point_10)  # -> flatten(UIsocurve), VIsocurve
loft_20 = Loft(
    Curves=iso_curve_10.UIsocurve,
    Options={Adjust=False, Closed=False, LoftEnds=0, LoftSimp=0, LoftType=0, Rebuild=10, Refit=0.01})

# ---- group: Separating Panels Function
u_count = Slider(40, range=0..100)
v_count = Slider(100, range=0..100)
quad_panels = QuadPanels(Surface=loft_16, UDivisions=u_count, VDivisions=v_count)
surface = Surface(flatten(quad_panels))
path_mapper = PathMapper(surface, source="{A}(i)", target="{floor (i/100)}")

u_count_2 = Slider(40, range=0..100)
v_count_2 = Slider(100, range=0..100)
quad_panels_2 = QuadPanels(Surface=loft_18, UDivisions=u_count_2, VDivisions=v_count_2)
surface_2 = Surface(flatten(quad_panels_2))
path_mapper_2 = PathMapper(surface_2, source="{A}(i)", target="{floor (i/100)}")

u_count_3 = Slider(40, range=0..100)
v_count_3 = Slider(100, range=0..100)
quad_panels_3 = QuadPanels(Surface=loft_20, UDivisions=u_count_3, VDivisions=v_count_3)
surface_3 = Surface(flatten(quad_panels_3))
path_mapper_3 = PathMapper(surface_3, source="{A}(i)", target="{floor (i/100)}")

u_count_4 = Slider(40, range=0..100)
v_count_4 = Slider(100, range=0..100)
quad_panels_4 = QuadPanels(Surface=loft_12, UDivisions=u_count_4, VDivisions=v_count_4)
surface_4 = Surface(flatten(quad_panels_4))
path_mapper_4 = PathMapper(surface_4, source="{A}(i)", target="{floor (i/100)}")

u_count_5 = Slider(40, range=0..100)
v_count_5 = Slider(100, range=0..100)
quad_panels_5 = QuadPanels(Surface=loft_14, UDivisions=u_count_5, VDivisions=v_count_5)
surface_5 = Surface(flatten(quad_panels_5))
path_mapper_5 = PathMapper(surface_5, source="{A}(i)", target="{floor (i/100)}")

# ----
surface_6 = Surface([loft_3, loft_4, loft_5, loft_7, loft_9])

# ---- group: Panels & Frames Creation
# GRC PANEL BAGIAN BELAKANG (1)
cull_panels = Panel("""0
99""")
cull_index = CullIndex(List=path_mapper_2, Indices=cull_panels, Wrap=False)
brep_join_2 = BrepJoin(Breps=cull_index)  # -> Breps, Closed

# GRC PANEL BAGIAN BELAKANG (2)
list_panels = Panel("""0
98
99""")
cull_index_2 = CullIndex(List=path_mapper_3, Indices=list_panels, Wrap=False)
brep_join_3 = BrepJoin(Breps=cull_index_2)  # -> Breps, Closed

# ----
list_item_6 = ListItem(List=surface_6, Index="0", Wrap=False)
list_item_7 = ListItem(List=surface_6, Index="1", Wrap=False)
list_item_8 = ListItem(List=surface_6, Index="2", Wrap=False)
list_item_9 = ListItem(List=surface_6, Index="3", Wrap=False)
list_item_10 = ListItem(List=surface_6, Index="4", Wrap=False)
offset_brep_3 = OffsetBrep(
    Brep=[brep_join.Breps, brep],
    Distance=expr("-x", Slider(0.05, range=0..1)),
    Solid=Toggle(False),
    BothSides=Toggle(False),
    RoundCorners=Toggle(True),
    MergeFaces=Toggle(True))
offset_brep_4 = OffsetBrep(
    Brep=[brep_join.Breps, brep],
    Distance=expr("-x", Slider(0.15, range=0..1)),
    Solid=Toggle(False),
    BothSides=Toggle(False),
    RoundCorners=Toggle(True),
    MergeFaces=Toggle(True))
deconstruct_brep_3 = DeconstructBrep(Brep=offset_brep_3)  # -> flatten(Faces), Edges, Vertices
deconstruct_brep_4 = DeconstructBrep(Brep=offset_brep_4)  # -> flatten(Faces), Edges, Vertices

# ----
# Construct Mid Back Shell Cover
number_slider = Slider(0.1, range=0..1)
offset_surface = OffsetSurface(Surface=list_item_6, Distance=expr("-x", number_slider), Retrim=True)
offset_surface_2 = OffsetSurface(Surface=list_item_9, Distance=expr("-x", number_slider), Retrim=True)
offset_surface_3 = OffsetSurface(Surface=list_item_10, Distance=expr("-x", number_slider), Retrim=True)
offset_surface_4 = OffsetSurface(Surface=list_item_7, Distance=number_slider, Retrim=True)
offset_surface_5 = OffsetSurface(Surface=list_item_8, Distance=number_slider, Retrim=True)
curve_count_11 = Slider(2, range=0..100)
curve_count_12 = Slider(30, range=0..100)
curve_count_13 = Slider(2, range=0..100)
curve_count_14 = Slider(4, range=0..100)
curve_count_15 = Slider(30, range=0..100)
curve_count_16 = Slider(15, range=0..100)
curve_count_17 = Slider(2, range=0..100)
curve_count_18 = Slider(15, range=0..100)
curve_count_19 = Slider(4, range=0..100)
curve_count_20 = Slider(30, range=0..100)
divide_domain² = DivideDomain²(Domain=offset_surface, UCount=curve_count_11, VCount=curve_count_12)
divide_domain²_2 = DivideDomain²(Domain=offset_surface_4, UCount=curve_count_13, VCount=curve_count_16)
divide_domain²_3 = DivideDomain²(Domain=offset_surface_5, UCount=curve_count_17, VCount=curve_count_18)
divide_domain²_4 = DivideDomain²(Domain=offset_surface_2, UCount=curve_count_14, VCount=curve_count_15)
divide_domain²_5 = DivideDomain²(Domain=offset_surface_3, UCount=curve_count_19, VCount=curve_count_20)
isotrim = Isotrim(Surface=offset_surface, Domain=divide_domain²)
isotrim_2 = Isotrim(Surface=offset_surface_4, Domain=divide_domain²_2)
isotrim_3 = Isotrim(Surface=offset_surface_5, Domain=divide_domain²_3)
isotrim_4 = Isotrim(Surface=offset_surface_2, Domain=divide_domain²_4)
isotrim_5 = Isotrim(Surface=offset_surface_3, Domain=divide_domain²_5)
area = Area(Geometry=[isotrim, isotrim_2, isotrim_3, isotrim_4, isotrim_5])  # -> Area, Centroid
scale = Scale(Geometry=[isotrim, isotrim_2, isotrim_3, isotrim_4, isotrim_5], Center=area.Centroid, Factor=Slider(0.995, range=0..1))  # -> Geometry, Transform

# ----
# Construct Mid Back Shell Pipes
number_slider_2 = Slider(0.05, range=0..1)
offset_surface_6 = OffsetSurface(Surface=list_item_6, Distance=expr("-x", number_slider_2), Retrim=True)
offset_surface_7 = OffsetSurface(Surface=list_item_7, Distance=expr("-x", number_slider_2), Retrim=True)
offset_surface_8 = OffsetSurface(Surface=list_item_8, Distance=expr("-x", number_slider_2), Retrim=True)
offset_surface_9 = OffsetSurface(Surface=list_item_9, Distance=expr("-x", number_slider_2), Retrim=True)
offset_surface_10 = OffsetSurface(Surface=list_item_10, Distance=expr("-x", number_slider_2), Retrim=True)
domain_11 = Slider(1, range=0..1)
curve_count_21 = Slider(30, range=0..100)
domain_12 = Slider(1, range=0..1)
curve_count_22 = Slider(15, range=0..100)
domain_13 = Slider(1, range=0..1)
curve_count_23 = Slider(4, range=0..100)
domain_14 = Slider(1, range=0..1)
curve_count_24 = Slider(30, range=0..100)
range_12 = Range(Domain=domain_11, Steps=curve_count_21)
range_13 = Range(Domain=domain_12, Steps=curve_count_22)
range_14 = Range(Domain=domain_13, Steps=curve_count_23)
range_15 = Range(Domain=domain_14, Steps=curve_count_24)
construct_point_11 = ConstructPoint(XCoordinate=0, YCoordinate=range_12, ZCoordinate=0)
construct_point_12 = ConstructPoint(XCoordinate=0, YCoordinate=range_13, ZCoordinate=0)
construct_point_13 = ConstructPoint(XCoordinate=range_14, YCoordinate=range_15, ZCoordinate=0)
iso_curve_11 = IsoCurve(Surface=reparameterize(offset_surface_6), UVPoint=construct_point_11)  # -> flatten(UIsocurve), flatten(VIsocurve)
iso_curve_12 = IsoCurve(Surface=reparameterize(offset_surface_7), UVPoint=construct_point_12)  # -> flatten(UIsocurve), flatten(VIsocurve)
iso_curve_13 = IsoCurve(Surface=reparameterize(offset_surface_8), UVPoint=construct_point_12)  # -> flatten(UIsocurve), flatten(VIsocurve)
iso_curve_14 = IsoCurve(Surface=reparameterize(offset_surface_9), UVPoint=construct_point_13)  # -> flatten(UIsocurve), flatten(VIsocurve)
iso_curve_15 = IsoCurve(Surface=reparameterize(offset_surface_10), UVPoint=construct_point_13)  # -> flatten(UIsocurve), flatten(VIsocurve)
panel = Panel("""0
1
2
3
4
5
6
30
29
27
26
25
24""")
panel_2 = Panel("""0
30""")
panel_3 = Panel("""0
1
30
29""")
panel_4 = Panel("""0
1
2
15
14
13""")
panel_5 = Panel("""0
1
2
15
14
13""")
panel_6 = Panel("""1
2
3""")
panel_7 = Panel("""1
2
3""")
cull_index_3 = CullIndex(List=iso_curve_11.UIsocurve, Indices=panel, Wrap=False)
cull_index_4 = CullIndex(List=iso_curve_12.UIsocurve, Indices=panel_4, Wrap=False)
cull_index_5 = CullIndex(List=iso_curve_13.UIsocurve, Indices=panel_5, Wrap=False)
cull_index_6 = CullIndex(List=iso_curve_14.UIsocurve, Indices=panel_2, Wrap=False)
cull_index_7 = CullIndex(List=iso_curve_15.UIsocurve, Indices=panel_3, Wrap=False)
list_item_11 = ListItem(List=iso_curve_14.VIsocurve, Index=panel_6, Wrap=False)
list_item_12 = ListItem(List=iso_curve_15.VIsocurve, Index=panel_7, Wrap=False)
curve_26 = Curve(cull_index_4)
curve_27 = Curve(cull_index_6)
curve_28 = Curve(list_item_11)
curve_29 = Curve(cull_index_7)
curve_30 = Curve(list_item_12)
curve_31 = Curve(cull_index_3)
curve_32 = Curve(cull_index_5)

list_item_13 = ListItem(List=deconstruct_brep_3.Faces, Index="0", Wrap=True)
list_item_14 = ListItem(List=deconstruct_brep_3.Faces, Index="1", Wrap=True)
list_item_15 = ListItem(List=deconstruct_brep_3.Faces, Index="2", Wrap=True)
list_item_16 = ListItem(List=deconstruct_brep_3.Faces, Index="3", Wrap=True)
list_item_17 = ListItem(List=deconstruct_brep_3.Faces, Index="4", Wrap=True)
list_item_18 = ListItem(List=deconstruct_brep_4.Faces, Index="0", Wrap=True)
list_item_19 = ListItem(List=deconstruct_brep_4.Faces, Index="1", Wrap=True)
list_item_20 = ListItem(List=deconstruct_brep_4.Faces, Index="2", Wrap=True)
list_item_21 = ListItem(List=deconstruct_brep_4.Faces, Index="3", Wrap=True)
list_item_22 = ListItem(List=deconstruct_brep_4.Faces, Index="4", Wrap=True)

# ----
# Construct Secondary Shell Pipes
domain_15 = Slider(1, range=0..1)
curve_count_25 = Slider(100, range=0..100)
range_16 = Range(Domain=domain_15, Steps=curve_count_25)
construct_point_14 = ConstructPoint(XCoordinate=0, YCoordinate=range_16, ZCoordinate=0)
surface_7 = Surface(list_item_19)
surface_8 = Surface(list_item_21)
surface_9 = Surface(list_item_22)
surface_10 = Surface(list_item_18)
surface_11 = Surface(list_item_20)
iso_curve_16 = IsoCurve(Surface=reparameterize(surface_10), UVPoint=construct_point_14)  # -> flatten(UIsocurve), VIsocurve
iso_curve_17 = IsoCurve(Surface=reparameterize(surface_7), UVPoint=construct_point_14)  # -> flatten(UIsocurve), VIsocurve
iso_curve_18 = IsoCurve(Surface=reparameterize(surface_11), UVPoint=construct_point_14)  # -> flatten(UIsocurve), VIsocurve
iso_curve_19 = IsoCurve(Surface=reparameterize(surface_8), UVPoint=construct_point_14)  # -> flatten(UIsocurve), VIsocurve
iso_curve_20 = IsoCurve(Surface=reparameterize(surface_9), UVPoint=construct_point_14)  # -> flatten(UIsocurve), VIsocurve
panel_8 = Panel("""0
1
97
98""")
panel_9 = Panel("""0
1
97
98""")
panel_10 = Panel("""0
1
99
100""")
panel_11 = Panel("""0
100""")
panel_12 = Panel("""0
1
100""")
cull_index_8 = CullIndex(List=iso_curve_16.UIsocurve, Indices=panel_8, Wrap=False)
cull_index_9 = CullIndex(List=iso_curve_17.UIsocurve, Indices=panel_9, Wrap=False)
cull_index_10 = CullIndex(List=iso_curve_18.UIsocurve, Indices=panel_10, Wrap=False)
cull_index_11 = CullIndex(List=iso_curve_19.UIsocurve, Indices=panel_11, Wrap=False)
cull_index_12 = CullIndex(List=iso_curve_20.UIsocurve, Indices=panel_12, Wrap=False)

# ----
# Construct Tween Shell Pipes
domain_16 = Slider(1, range=0..1)
curve_count_26 = Slider(100, range=0..100)
range_17 = Range(Domain=domain_16, Steps=curve_count_26)
domain_17 = Slider(1, range=0..1)
curve_count_27 = Slider(20, range=0..100)
construct_point_15 = ConstructPoint(XCoordinate=0, YCoordinate=range_17, ZCoordinate=0)
surface_12 = Surface(list_item_13)
surface_13 = Surface(list_item_14)
surface_14 = Surface(list_item_15)
surface_15 = Surface(list_item_16)
surface_16 = Surface(list_item_17)
iso_curve_21 = IsoCurve(Surface=reparameterize(surface_12), UVPoint=construct_point_15)  # -> flatten(UIsocurve), VIsocurve
iso_curve_22 = IsoCurve(Surface=reparameterize(surface_13), UVPoint=construct_point_15)  # -> flatten(UIsocurve), VIsocurve
iso_curve_23 = IsoCurve(Surface=reparameterize(surface_14), UVPoint=construct_point_15)  # -> flatten(UIsocurve), VIsocurve
iso_curve_24 = IsoCurve(Surface=reparameterize(surface_15), UVPoint=construct_point_15)  # -> flatten(UIsocurve), VIsocurve
iso_curve_25 = IsoCurve(Surface=reparameterize(surface_16), UVPoint=construct_point_15)  # -> flatten(UIsocurve), VIsocurve
range_18 = Range(Domain=domain_17, Steps=curve_count_27)
loft_21 = Loft(
    Curves=iso_curve_21.UIsocurve,
    Options={Adjust=False, Closed=False, LoftEnds=0, LoftSimp=0, LoftType=0, Rebuild=10, Refit=0.01})
loft_22 = Loft(
    Curves=iso_curve_22.UIsocurve,
    Options={Adjust=False, Closed=False, LoftEnds=0, LoftSimp=0, LoftType=0, Rebuild=10, Refit=0.01})
loft_23 = Loft(
    Curves=iso_curve_23.UIsocurve,
    Options={Adjust=False, Closed=False, LoftEnds=0, LoftSimp=0, LoftType=0, Rebuild=10, Refit=0.01})
loft_24 = Loft(
    Curves=iso_curve_24.UIsocurve,
    Options={Adjust=False, Closed=False, LoftEnds=0, LoftSimp=0, LoftType=0, Rebuild=10, Refit=0.01})
loft_25 = Loft(
    Curves=iso_curve_25.UIsocurve,
    Options={Adjust=False, Closed=False, LoftEnds=0, LoftSimp=0, LoftType=0, Rebuild=10, Refit=0.01})
construct_point_16 = ConstructPoint(XCoordinate=0, YCoordinate=range_18, ZCoordinate=0)
iso_curve_26 = IsoCurve(Surface=reparameterize(loft_21), UVPoint=construct_point_16)  # -> UIsocurve, VIsocurve
iso_curve_27 = IsoCurve(Surface=reparameterize(loft_22), UVPoint=construct_point_16)  # -> UIsocurve, VIsocurve
iso_curve_28 = IsoCurve(Surface=reparameterize(loft_23), UVPoint=construct_point_16)  # -> UIsocurve, VIsocurve
iso_curve_29 = IsoCurve(Surface=reparameterize(loft_24), UVPoint=construct_point_16)  # -> UIsocurve, VIsocurve
iso_curve_30 = IsoCurve(Surface=reparameterize(loft_25), UVPoint=construct_point_16)  # -> UIsocurve, VIsocurve
panel_13 = Panel("""0
20""")
cull_index_13 = CullIndex(List=flatten(iso_curve_26.UIsocurve), Indices=panel_13, Wrap=True)
cull_index_14 = CullIndex(List=flatten(iso_curve_27.UIsocurve), Indices=panel_13, Wrap=True)
cull_index_15 = CullIndex(List=flatten(iso_curve_28.UIsocurve), Indices=panel_13, Wrap=True)
cull_index_16 = CullIndex(List=flatten(iso_curve_29.UIsocurve), Indices=panel_13, Wrap=True)
cull_index_17 = CullIndex(List=flatten(iso_curve_30.UIsocurve), Indices=panel_13, Wrap=True)

# ----
# Construct Primary Shell Pipes
curve_33 = Curve([curve, curve_6, join_curves, join_curves_2, curve_13, curve_2, curve_3, curve_4, curve_5])

offset_surface_11 = OffsetSurface(Surface=scale.Geometry, Distance=expr("-x", Slider(0.1, range=0..1)), BothSides=0, CreateSolid=True)

control_knob = ControlKnob(Decimals=2, Limit=True, Maximum=10, Minimum=0, Range=1, Value=0.05)
pipe = Pipe(Curve=[curve_31, curve_26, curve_32, curve_27, curve_28, curve_29, curve_30], Radius=control_knob, Caps=1)

control_knob_2 = ControlKnob(Decimals=2, Limit=True, Maximum=10, Minimum=0, Range=1, Value=0.1)
pipe_2 = Pipe(Curve=curve_33, Radius=control_knob_2, Caps=1)

# ---- group: Panels & Frames Creation / GRC Panels Thickness
panels_thickness = Slider(0.1, range=0..1)
offset_brep_5 = OffsetBrep(
    Brep=brep_join_3.Breps,
    Distance=expr("-X", panels_thickness),
    Solid=Toggle(True),
    BothSides=Toggle(False),
    RoundCorners=Toggle(True),
    MergeFaces=Toggle(False))

panels_thickness_2 = Slider(0.1, range=0..1)
offset_brep_6 = OffsetBrep(
    Brep=brep_join_2.Breps,
    Distance=expr("-X", panels_thickness_2),
    Solid=Toggle(True),
    BothSides=Toggle(False),
    RoundCorners=Toggle(True),
    MergeFaces=Toggle(False))

# ----
control_knob_3 = ControlKnob(Decimals=2, Limit=True, Maximum=10, Minimum=0, Range=1, Value=0.05)
pipe_3 = Pipe(Curve=[cull_index_8, cull_index_9, cull_index_10, cull_index_11, cull_index_12], Radius=control_knob_3, Caps=1)

control_knob_4 = ControlKnob(Decimals=2, Limit=True, Maximum=10, Minimum=0, Range=1, Value=0.05)
pipe_4 = Pipe(Curve=[cull_index_13, cull_index_14, cull_index_15, cull_index_16, cull_index_17], Radius=control_knob_4, Caps=1)

# ---- group: Panels & Frames Creation
# SELUBUNG KINETIK BAGIAN BELAKANG
list_panels_2 = Panel("""2
3
4
5
6
7
8
9
10
11
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""")
cull_panels_2 = Panel("""0
1
2
3
4
5
6
7
8
9
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""")
cull_index_18 = CullIndex(List=path_mapper, Indices=cull_panels_2, Wrap=False)
list_item_59_max = ListItem(List=path_mapper, Index=list_panels_2, Wrap=False)
frames_scale = Slider(0.8, range=0..1)
panel_frame = PanelFrame(Panel=cull_index_18, ScaleFactor=frames_scale)  # -> PanelFrame, Panel
brep_join_4 = BrepJoin(Breps=list_item_59_max)  # -> Breps, Closed
brep_2 = Brep(panel_frame.PanelFrame)
kinetic_fins_angle = Slider(0, range=0..90)

# ----
brep_3 = Brep(panel_frame.Panel)

# ---- group: Panels & Frames Creation / Fins Surfaces
offset_surface_12 = OffsetSurface(Surface=brep_3, Distance=expr("-x", Slider(0.1, range=0..1)), Retrim=True)

# ---- group: Panels & Frames Creation / Polycarbonate Glass Surfaces
glass_thickness = Slider(0.05, range=0..1)
offset_surface_13 = OffsetSurface(Surface=brep_3, Distance=expr("-x", glass_thickness), Retrim=True)

# ----
explode = Explode(Curve=offset_surface_12, Recursive=True)  # -> Segments, Vertices

# ---- group: Panels & Frames Creation (continued)
area_2 = Area(Geometry=offset_surface_12)  # -> Area, graft(Centroid)
extrude_point = ExtrudePoint(Base=explode.Segments, Point=area_2.Centroid)
rotate_axis = RotateAxis(Geometry=extrude_point, Angle=expr("-x", degrees(kinetic_fins_angle)), Axis=explode.Segments)  # -> Geometry, Transform

# ---- group: Panels & Frames Creation / GRC Panels Thickness
panels_thickness_3 = Slider(0.1, range=0..1)
offset_brep_7 = OffsetBrep(
    Brep=brep_join_4.Breps,
    Distance=expr("-X", panels_thickness_3),
    Solid=Toggle(True),
    BothSides=Toggle(False),
    RoundCorners=Toggle(False),
    MergeFaces=Toggle(True))

# ---- group: Frames
frames_thickness = Slider(0.1, range=0..1)
offset_surface_14 = OffsetSurface(Surface=brep_2, Distance=frames_thickness, BothSides=0, CreateSolid=True)

# ---- group: Panels & Frames Creation / Kinetic Fins
fins_thickness = Slider(0.002, range=0..1)
offset_surface_15 = OffsetSurface(Surface=rotate_axis.Geometry, Distance=expr("-x", fins_thickness), BothSides=0, CreateSolid=True)

# ---- group: Panels & Frames Creation / Fiberglass
fins_thickness_2 = Slider(0.01, range=0..1)
offset_surface_16 = OffsetSurface(Surface=offset_surface_13, Distance=expr("-x", fins_thickness_2), BothSides=0, CreateSolid=True)

# ---- group: Panels & Frames Creation
# SELUBUNG KINETIK BAGIAN DEPAN
cull_panels_3 = Panel("""0
10
11
12
13
14
15
16
17
18
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""")
list_panels_3 = Panel("""10
11
12
13
14
15
16
17
18
19
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""")
cull_index_19 = CullIndex(List=path_mapper_4, Indices=cull_panels_3, Wrap=False)
list_item_59_max_2 = ListItem(List=path_mapper_4, Index=list_panels_3, Wrap=False)
frames_scale_2 = Slider(0.8, range=0..1)
panel_frame_2 = PanelFrame(Panel=list_item_59_max_2, ScaleFactor=frames_scale_2)  # -> PanelFrame, Panel
brep_join_5 = BrepJoin(Breps=cull_index_19)  # -> Breps, Closed
brep_4 = Brep(panel_frame_2.PanelFrame)
brep_join_6 = BrepJoin(Breps=brep_4)  # -> Breps, Closed
kinetic_fins_angle_2 = Slider(0, range=0..90)

# ----
brep_5 = Brep(panel_frame_2.Panel)

# ---- group: Panels & Frames Creation / Fins Surfaces
offset_surface_17 = OffsetSurface(Surface=brep_5, Distance=expr("-x", Slider(0.1, range=0..1)), Retrim=True)

# ---- group: Panels & Frames Creation / Polycarbonate Glass Surfaces
glass_thickness_2 = Slider(0.05, range=0..1)
offset_surface_18 = OffsetSurface(Surface=brep_5, Distance=expr("-x", glass_thickness_2), Retrim=True)

# ----
explode_2 = Explode(Curve=offset_surface_17, Recursive=True)  # -> Segments, Vertices

# ---- group: Panels & Frames Creation (continued)
area_3 = Area(Geometry=offset_surface_17)  # -> Area, graft(Centroid)
extrude_point_2 = ExtrudePoint(Base=explode_2.Segments, Point=area_3.Centroid)
rotate_axis_2 = RotateAxis(Geometry=extrude_point_2, Angle=expr("-x", degrees(kinetic_fins_angle_2)), Axis=explode_2.Segments)  # -> Geometry, Transform

# ---- group: Panels & Frames Creation / GRC Panels Thickness
panels_thickness_4 = Slider(0.1, range=0..1)
offset_brep_8 = OffsetBrep(
    Brep=brep_join_5.Breps,
    Distance=expr("-X", panels_thickness_4),
    Solid=Toggle(True),
    BothSides=Toggle(False),
    RoundCorners=Toggle(True),
    MergeFaces=Toggle(False))

# ---- group: Panels & Frames Creation / Frames
frames_thickness_2 = Slider(0.1, range=0..1)
offset_brep_9 = OffsetBrep(
    Brep=brep_join_6.Breps,
    Distance=frames_thickness_2,
    Solid=Toggle(True),
    BothSides=Toggle(False),
    RoundCorners=Toggle(True),
    MergeFaces=Toggle(False))

# ---- group: Panels & Frames Creation / Polycarbonate Glass
fins_thickness_3 = Slider(0.01, range=0..1)
offset_surface_19 = OffsetSurface(Surface=offset_surface_18, Distance=expr("-x", fins_thickness_3), BothSides=0, CreateSolid=True)

# ---- group: Panels & Frames Creation / Kinetic Fins
fins_thickness_4 = Slider(0.002, range=0..1)
offset_surface_20 = OffsetSurface(Surface=rotate_axis_2.Geometry, Distance=expr("-x", fins_thickness_4), BothSides=0, CreateSolid=True)

# ---- group: Panels & Frames Creation
# SELUBUNG KINETIK BAGIAN ATAS
list_panels_4 = Panel("""1
2
3
4
5
6
7
8
9
10
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""")
cull_panels_4 = Panel("""0
1
2
3
4
5
6
7
8
9
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""")
list_item_59_max_3 = ListItem(List=path_mapper_5, Index=list_panels_4, Wrap=False)
frames_scale_3 = Slider(0.8, range=0..1)
brep_join_7 = BrepJoin(Breps=list_item_59_max_3)  # -> Breps, Closed
kinetic_fins_angle_3 = Slider(90, range=0..90)

# ----
cull_index_20 = CullIndex(List=path_mapper_5, Indices=cull_panels_4, Wrap=False)

# ---- group: Panels & Frames Creation / GRC Panels Thickness
panels_thickness_5 = Slider(0.1, range=0..1)
offset_brep_10 = OffsetBrep(
    Brep=brep_join_7.Breps,
    Distance=expr("-X", panels_thickness_5),
    Solid=Toggle(True),
    BothSides=Toggle(False),
    RoundCorners=Toggle(False),
    MergeFaces=Toggle(True))

# ---- group: Panels & Frames Creation (continued)
panel_frame_3 = PanelFrame(Panel=cull_index_20, ScaleFactor=frames_scale_3)  # -> PanelFrame, Panel
brep_6 = Brep(panel_frame_3.PanelFrame)

# ----
brep_7 = Brep(panel_frame_3.Panel)

# ---- group: Panels & Frames Creation / Fins Surfaces
offset_surface_21 = OffsetSurface(Surface=brep_7, Distance=expr("-x", Slider(0.1, range=0..1)), Retrim=True)

# ---- group: Panels & Frames Creation / Polycarbonate Glass Surfaces
glass_thickness_3 = Slider(0.05, range=0..1)
offset_surface_22 = OffsetSurface(Surface=brep_7, Distance=expr("-x", glass_thickness_3), Retrim=True)

# ----
explode_3 = Explode(Curve=offset_surface_21, Recursive=True)  # -> Segments, Vertices

# ---- group: Panels & Frames Creation (continued)
area_4 = Area(Geometry=offset_surface_21)  # -> Area, graft(Centroid)
extrude_point_3 = ExtrudePoint(Base=explode_3.Segments, Point=area_4.Centroid)
rotate_axis_3 = RotateAxis(Geometry=extrude_point_3, Angle=expr("-x", degrees(kinetic_fins_angle_3)), Axis=explode_3.Segments)  # -> Geometry, Transform

# ---- group: Frames
frames_thickness_3 = Slider(0.1, range=0..1)
offset_surface_23 = OffsetSurface(Surface=brep_6, Distance=frames_thickness_3, BothSides=0, CreateSolid=True)

# ---- group: Panels & Frames Creation / Kinetic Fins
fins_thickness_5 = Slider(0.002, range=0..1)
offset_surface_24 = OffsetSurface(Surface=rotate_axis_3.Geometry, Distance=expr("-x", fins_thickness_5), BothSides=0, CreateSolid=True)

# ---- group: Panels & Frames Creation / Polycarbonate Glass
fins_thickness_6 = Slider(0.01, range=0..1)
offset_surface_25 = OffsetSurface(Surface=offset_surface_22, Distance=expr("-x", fins_thickness_6), BothSides=0, CreateSolid=True)
